# Grasshopper definition ImageRegionSelector.gh (Grasshopper 0.9.76)
# plug-ins: Python Interpreter

image_step = Slider(51, range=0..100)
ladybug = Ladybug_Ladybug()  # -> Vviiiiiiiiiizzz; plug-in component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
image_steps = Number(image_step)
path = FilePath("C:\Users\LJobson\Documents\GitHub\SolarSculptor\resources\testImage\GradientImg4Color.png")

# ----
# Active Brush
python_script = PythonScript(imagePath=path, run=Toggle(True), step=image_steps)  # -> out, redData, greenData, blueData, alphaData, xSize, ySize; inputs run: Boolean, step: Int32
# ---------- python_script: Python ----------
import os
from System import Object
import Grasshopper.Kernel as gh
from Grasshopper import DataTree
from Grasshopper.Kernel.Data import GH_Path
from System.Drawing import Image

redDataTree = DataTree[Object]()
greenDataTree = DataTree[Object]()
blueDataTree = DataTree[Object]()
alphaDataTree = DataTree[Object]()
redData = []
greenData = []
blueData =[]
alphaData=[]

if run:
    img = Image.FromFile(imagePath)
    for indexY, y in enumerate(range(0, img.Height,step)):

        yPath = GH_Path(indexY)
        for indexX, x in enumerate(range(0,img.Width, step)):
            colorData = img.GetPixel(x, y)
            redDataTree.Add(colorData.R/255, yPath)
            greenDataTree.Add(colorData.G/255, yPath)
            blueDataTree.Add(colorData.B/255, yPath)
            alphaDataTree.Add(colorData.A/255, yPath)
img.Dispose()
redData, greenData, blueData, alphaData = [redDataTree, greenDataTree, blueDataTree, alphaDataTree]
xSize = indexX; ySize = indexY
# ---------- end python_script ----------
timer = Timer(TimerInterval=1000, Target=python_script)  # disabled

interest_spot_threshold = Slider(0.13, range=0..0.5)
height_multiplier = Slider(4, range=1..50)

# ----
# Active Workspace
cluster = Cluster(
    reddata=python_script.redData,
    greendata=python_script.greenData,
    bluedata=python_script.blueData,
    xsize=python_script.xSize,
    ysize=python_script.ySize,
    place_of_interest_threshold=interest_spot_threshold,
    height_multiplier=height_multiplier)  # -> points_of_interest_2, areas_of_interest_2, topo_fragments_to_color_2, topo_colors_2, toposurface_2

preview = CustomPreview(Geometry=cluster.topo_fragments_to_color_2, Shader=flatten(cluster.topo_colors_2))
points_of_interest = Point(cluster.points_of_interest_2)
areas_of_interest = Curve(cluster.areas_of_interest_2)

# ==== cluster Cluster
height_multiplier = ClusterInput()
place_of_interest_threshold = ClusterInput()
reddata = ClusterInput()
greendata = ClusterInput()
bluedata = ClusterInput()
xsize = ClusterInput()
ysize = ClusterInput()

place_of_interest_threshold_2 = Number(place_of_interest_threshold)
height_multiplier_2 = Number(height_multiplier)
greendata_2 = Number(greendata)
bluedata_2 = Number(bluedata)
reddata_2 = Number(reddata)
ysize_2 = Number(ysize)
xsize_2 = Number(xsize)

greendata_3 = Number(greendata_2)

# ----
# Landscape from Colors
square = Square(Plane=PlaneXY(0, 0, 0), Size=1, ExtentX=xsize_2, ExtentY=ysize_2)  # -> Cells, Points
deconstruct = Deconstruct(Point=square.Points)  # -> simplify(XComponent), simplify(YComponent), ZComponent
multiplication = Multiplication(A=bluedata_2, B=height_multiplier_2)
construct_point = ConstructPoint(XCoordinate=deconstruct.XComponent, YCoordinate=deconstruct.YComponent, ZCoordinate=multiplication)
interpolate = Interpolate(Vertices=construct_point, Degree=3, Periodic=False, KnotStyle=1)  # -> Curve, Length, Domain
loft = Loft(
    Curves=flatten(interpolate.Curve),
    Options={Adjust=False, Closed=False, LoftEnds=0, LoftSimp=0, LoftType=0, Rebuild=10, Refit=0.01})

# ----
# Select Mesh
rectangle = Rectangle(Plane=PlaneXY(0, 0, 0), XSize=xsize_2, YSize=ysize_2, Radius=0)  # -> Rectangle, Length
mplane = MeshPlane(Boundary=rectangle.Rectangle, WidthCount=ysize_2, HeightCount=ysize_2)  # -> Mesh, Area
flip = FlipMatrix(Data=reddata_2)
meshselector = Ladybug_MeshThresholdSelector(inputMesh=mplane.Mesh, analysisResult=flatten(flip), operator=">", levelOfPerform=place_of_interest_threshold_2)  # -> readMe, totalValue, areaMeetsThresh, newColoredMesh, newMeshOutline; plug-in component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
demesh = DeconstructMesh(Mesh=meshselector.newColoredMesh)  # -> Vertices, Faces, Colours, Normals

# ----
# Color Topo Fragments
mesh = MeshBrep(
    Brep=loft,
    Settings={GridMaxCount=0, GridMinCount=16, JaggedSeams=False, MaxEdgeLength=0, MinEdgeLength=0.0001, MinTolerance=0, Refine=True, RefineAngle=0, RelativeTolerance=0.65, SimplePlanes=True, Tolerance=0})
explode = MeshExplode(Mesh=mesh, Interpolate=False)
demesh_2 = DeconstructMesh(Mesh=explode)  # -> Vertices, Faces, Colours, Normals
item = ListItem(List=demesh_2.Vertices, Index=0, Wrap=True)
pdecon = Deconstruct(Point=item)  # -> XComponent, YComponent, ZComponent
bnd = Bounds(Numbers=flatten(pdecon.ZComponent))
remap = RemapNumbers(Value=pdecon.ZComponent, Source=bnd, Target=Domain(0, 1))  # -> Mapped, Clipped
gradient = Gradient(
    LowerLimit=0,
    UpperLimit=1,
    Parameter=remap.Mapped,
    stops=[0: RGB(0, 97, 68), 0.25: RGB(81, 175, 17), 0.5: RGB(159, 198, 146), 0.75: RGB(170, 235, 41), 1: RGB(221, 255, 53)])

topo_fragments_to_color = Geometry(explode)
points_of_interest = Point(demesh.Vertices)
areas_of_interest = Curve(meshselector.newMeshOutline)
topo_colors = Data(gradient)
toposurface = Surface(loft)

points_of_interest_2 = ClusterOutput(points_of_interest)
toposurface_2 = ClusterOutput(toposurface)
areas_of_interest_2 = ClusterOutput(areas_of_interest)
topo_colors_2 = ClusterOutput(topo_colors)
topo_fragments_to_color_2 = ClusterOutput(topo_fragments_to_color)
