# Grasshopper definition ImageRegion+TreePlacement.gh (Grasshopper 0.9.76)
# plug-ins: Python Interpreter

# ----
# Import EPW
# Import Bitmap
# https://www.energyplus.net/weather-download/north_and_central_america_wmo_region_4/USA/NY/USA_NY_New.York-J.F.Kennedy.Intl.AP.744860_TMY3/all
panel = Panel("https://www.energyplus.net/weather-download/north_and_central_america_wmo_region_4/USA/NY/USA_NY_New.York-J.F.Kennedy.Intl.AP.744860_TMY3/all")

design_directive_01 = Panel("Shade Tree Placement")
design_directive_02 = Panel("Shade Structure")
design_directive_03 = Panel("Massing")
ladybug = Ladybug_Ladybug()  # -> Vviiiiiiiiiizzz; plug-in component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
shade_tree_placement = BooleanToggle(False)
shade_structure = BooleanToggle(False)
massing = BooleanToggle(True)
timer = Timer(TimerInterval=1000, Target=python_script)

skym = BooleanToggle(False)
boolean_toggle = BooleanToggle(True)
image_steps = Number(45)
path = FilePath("C:\Users\LJ\Documents\GitHub\SolarSculptor\resources\testImage\GradientImg4Color.png")

# ----
# Active Brush
python_script = PythonScript(imagePath=path, run=boolean_toggle, step=image_steps)  # -> out, redData, greenData, blueData, alphaData, xSize, ySize; inputs run: Boolean, step: Int32
# ---------- python_script: Python ----------
import os
from System import Object
import Grasshopper.Kernel as gh
from Grasshopper import DataTree
from Grasshopper.Kernel.Data import GH_Path
from System.Drawing import Image

redDataTree = DataTree[Object]()
greenDataTree = DataTree[Object]()
blueDataTree = DataTree[Object]()
alphaDataTree = DataTree[Object]()
redData = []
greenData = []
blueData =[]
alphaData=[]

if run:
    img = Image.FromFile(imagePath)
    for indexY, y in enumerate(range(0, img.Height,step)):

        yPath = GH_Path(indexY)
        for indexX, x in enumerate(range(0,img.Width, step)):
            colorData = img.GetPixel(x, y)
            redDataTree.Add(colorData.R/255, yPath)
            greenDataTree.Add(colorData.G/255, yPath)
            blueDataTree.Add(colorData.B/255, yPath)
            alphaDataTree.Add(colorData.A/255, yPath)
img.Dispose()
redData, greenData, blueData, alphaData = [redDataTree, greenDataTree, blueDataTree, alphaDataTree]
xSize = indexX; ySize = indexY
# ---------- end python_script ----------

show_skymesh = Boolean(skym)

# ----
# Active Workspace
interest_spot_threshold = Slider(0.06, range=0..0.5)
height_multiplier = Slider(2, range=0..50)
cluster = Cluster(
    reddata=python_script.redData,
    greendata=python_script.greenData,
    bluedata=python_script.blueData,
    xsize=python_script.xSize,
    ysize=python_script.ySize,
    place_of_interest_threshold=interest_spot_threshold,
    height_multiplier=height_multiplier,
    landscape_size=Slider(100, range=100..300))  # -> points_on_topo_2, points_of_interest_2, areas_of_interest_2, topo_fragments_to_color_2, topo_colors_2, toposurface_2, nurbs_curves_2, working_surface_2

# ----
# Construct Sky Matrix
toggle = BooleanToggle(False)
cluster_2 = Cluster_2(weatherfileurl=panel, enable=toggle)  # -> skydome_mesh_2, skydome_points_2, radiation_values_2

# ----
# Represent Topo
jagged = SettingsSpeed()
mesh = MeshBrep(Brep=cluster.toposurface_2, Settings=jagged)
preview = CustomPreview(Geometry=mesh, Shader=ColourSwatch(SwatchColor=RGB(123, 138, 121)))

points_of_interest = Point(cluster.points_on_topo_2)
points_of_interest_2 = Point(cluster.points_of_interest_2)
areas_of_interest = Curve(cluster.areas_of_interest_2)

# ----
# Represent POI
circle = CircleCNR(Center=cluster.points_on_topo_2, Normal=Vector(0, 0, 1), Radius=0.2)
preview_2 = CustomPreview(Geometry=circle, Shader=ColourSwatch(SwatchColor=RGB(255, 255, 255)))

radiation_values = Number([7.17, 7.2, 7.33, 7.58, 8.06, 10.04, 14.77, 14.63, 15.81, 17.21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])
skydome_points = Point([Point(0, 495.4531246, 51.97717016), Point(103.0104967, 484.6262866, 51.97717017), Point(201.5189421, 452.6189525, 51.97717104), Point(291.2200421, 400.8299978, 51.97716862), Point(368.193427, 331.5228504, 51.97717082), Point(429.0749937, 247.7265633, 51.97717062)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])
enable = Boolean(boolean_toggle)
mesh_2 = Mesh(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)

# ----
# Decorative Outline
geo = Geometry(cluster.toposurface_2)
bbox = BoundingBox(Content=geo, Plane=PlaneXY(0, 0, 0))  # -> Box, Box_2
debrep = DeconstructBrep(Brep=bbox.Box)  # -> Faces, Edges, Vertices
item = ListItem(List=debrep.Faces, Index=4, Wrap=True)
offset = Offset(Curve=item, Distance=1, Plane=PlaneXY(0, 0, 0), Corners=1)
preview_3 = CustomPreview(Geometry=offset, Shader=ColourSwatch(SwatchColor=RGB(219, 219, 219)))

filter = StreamFilter(Gate=enable, Stream1=mesh_2)
filter_2 = StreamFilter(Gate=enable, Stream1=skydome_points)
filter_3 = StreamFilter(Gate=enable, Stream1=radiation_values)

# ----
# Input from Image
working_surface = Surface(cluster.working_surface_2)
points_of_interest_3 = Point(points_of_interest)
working_region = Curve(<curve referenced from the Rhino model>)
toposurface = Surface(cluster.toposurface_2)

filter_4 = StreamFilter(Gate=show_skymesh, Stream1=filter)

radiation_values_2 = Number(cluster_2.radiation_values_2)
skydome_points_2 = Point(cluster_2.skydome_points_2)
skydome_mesh = Mesh(cluster_2.skydome_mesh_2)  # disabled
radiation_values_3 = Number(filter_3)
skydome_points_3 = Point(filter_2)
mesh_3 = Mesh(filter_4)

preview_4 = CustomPreview(Geometry=working_region, Shader=ColourSwatch(SwatchColor=RGB(207, 207, 207)))

# ----
# Bre soleil
considered_vectors = Slider(3, range=1..20)
shade_density = Slider(10, range=10..20)
height = Slider(11, range=3..20)
cluster_3 = Cluster_6(
    height=height,
    toposurface=toposurface,
    skydome_points=skydome_points_3,
    radiation_values=radiation_values_3,
    areas_of_interest=areas_of_interest,
    shade_density=shade_density,
    considered_vectors=considered_vectors)  # disabled

# ----
# Shade Structure
considered_vectors_2 = Slider(3, range=1..20)
height_2 = Slider(15, range=3..20)
cluster_4 = Cluster_7(
    height=height_2,
    toposurface=toposurface,
    skydome_points=skydome_points_3,
    radiation_values=radiation_values_3,
    areas_of_interest=areas_of_interest,
    considered_vectors=considered_vectors_2,
    enabled=shade_structure)  # -> shade_structure_2, shade_structure_s_2

# ----
# Solve for Positioning
tree_height = Slider(15, range=1..20)
cluster_5 = Cluster_5(
    tree_height=tree_height,
    points_of_interest=points_of_interest_3,
    working_surface=toposurface,
    skydome_points=skydome_points_3,
    radiation_values=radiation_values_3,
    enabled=shade_tree_placement)  # -> height_2, points_within_reason_2

# ----
# Courtyard Massing
considered_vectors_3 = Slider(6, range=1..20)
distance_threshold = Slider(3, range=3..30)
max_bldg_height = Slider(31, range=3..50)
min_bldg_height = Slider(4, range=3..30)
height_3 = Slider(10, range=3..20)
cluster_6 = Cluster_8(
    dist_threshold=distance_threshold,
    height=height_3,
    min_height=min_bldg_height,
    toposurface=toposurface,
    max_height=max_bldg_height,
    skydome_points=skydome_points_3,
    radiation_values=radiation_values_3,
    areas_of_interest=areas_of_interest,
    considered_vectors=considered_vectors_3,
    enabled=massing)  # -> massings_2, col_2

# ----
# Visualize Vectors
radiation_values_4 = Number(radiation_values_3)
skydome_points_4 = Point(skydome_points_3)
vec2pt = Vector2Pt(PointA=skydome_points_4, PointB="0,0,0", Unitize=False)  # -> unitize(Vector), Length
bnd = Bounds(Numbers=radiation_values_4)
multiplication = Multiplication(A=vec2pt.Vector, B=radiation_values_4)
vdisex = VectorDisplayEx(Point=skydome_points_4, Vector=multiplication, Colour=ColourSwatch(SwatchColor=RGBA(219, 219, 219, 105)), Width=2)

jagged_2 = SettingsSpeed()
mesh_4 = MeshBrep(Brep=cluster_6.massings_2, Settings=jagged_2)
shade_structure_2 = Geometry(mesh_4)
preview_5 = CustomPreview(Geometry=shade_structure_2, Shader=cluster_6.col_2)

# ----
# Apply Trees
trees_per_area = Slider(12, range=0..20)
cluster_7 = Cluster_4(
    tree_height=cluster_5.height_2,
    possible_trees_within_reason=cluster_5.points_within_reason_2,
    trees_per_patch=trees_per_area)

shade_structure_3 = Geometry(cluster_4.shade_structure_2)
preview_6 = CustomPreview(Geometry=shade_structure_3, Shader=ColourSwatch(SwatchColor=RGB(184, 184, 184)))

shade_structure_4 = Geometry(cluster_4.shade_structure_s_2)
preview_7 = CustomPreview(Geometry=shade_structure_4, Shader=ColourSwatch(SwatchColor=RGB(255, 255, 255)))

shade_structure_5 = Geometry(cluster_3)
preview_8 = CustomPreview(Geometry=shade_structure_5, Shader=ColourSwatch(SwatchColor=RGB(214, 214, 214)))

# ----
# Generate Rep
cluster_8 = Cluster_3(trees_as_crvs=cluster_7)  # -> tree_objects_2, stick_2

# ----
# Visualize By Efficiency
tree_objects = Geometry(cluster_8.tree_objects_2)
lng = ListLength(List=tree_objects)
range = Range(Domain=Domain(0, 1), Steps=expr("x-1", lng))
gradient = Gradient(
    LowerLimit=0,
    UpperLimit=1,
    Parameter=range,
    stops=[0: RGB(234, 38, 0), 0.25: RGB(234, 126, 0), 0.5: RGB(254, 244, 84), 0.75: RGB(173, 203, 249), 1: RGB(75, 107, 169)])
preview_9 = CustomPreview(Geometry=tree_objects, Shader=gradient)

# ==== cluster Cluster
place_of_interest_threshold = ClusterInput()
height_multiplier = ClusterInput()
greendata = ClusterInput()
bluedata = ClusterInput()
reddata = ClusterInput()
ysize = ClusterInput()
xsize = ClusterInput()

place_of_interest_threshold_2 = Number(place_of_interest_threshold)
height_multiplier_2 = Number(height_multiplier)
greendata_2 = Number(greendata)
bluedata_2 = Number(bluedata)
reddata_2 = Number(reddata)
ysize_2 = Number(ysize)
xsize_2 = Number(xsize)

greendata_3 = Number(greendata_2)

# ----
# Landscape from Colors
square = Square(Plane=PlaneXY(0, 0, 0), Size=1, ExtentX=xsize_2, ExtentY=ysize_2)  # -> Cells, Points
deconstruct = Deconstruct(Point=square.Points)  # -> simplify(XComponent), simplify(YComponent), ZComponent
multiplication = Multiplication(A=bluedata_2, B=height_multiplier_2)
construct_point = ConstructPoint(XCoordinate=deconstruct.XComponent, YCoordinate=deconstruct.YComponent, ZCoordinate=multiplication)
interpolate = Interpolate(Vertices=construct_point, Degree=3, Periodic=False, KnotStyle=1)  # -> Curve, Length, Domain
loft = Loft(
    Curves=flatten(interpolate.Curve),
    Options={Adjust=False, Closed=False, LoftEnds=0, LoftSimp=0, LoftType=0, Rebuild=10, Refit=0.01})  # disabled

number_slider = Slider(9, range=0..20)
bbox = BoundingBox(Content=flatten(interpolate.Curve), Plane=PlaneXY(0, 0, 0), UnionBox=True)  # -> Box, Box_2
landscape_size = ClusterInput()
debox = DeconstructBox(Box=bbox.Box)  # -> Plane, X, Y, Z
landscape_size_2 = Number(landscape_size)

# ----
# Color Topo Fragments
mesh = MeshBrep(
    Brep=loft,
    Settings={GridMaxCount=0, GridMinCount=16, JaggedSeams=False, MaxEdgeLength=0, MinEdgeLength=0.0001, MinTolerance=0, Refine=True, RefineAngle=0, RelativeTolerance=0.65, SimplePlanes=True, Tolerance=0})
explode = MeshExplode(Mesh=mesh, Interpolate=False)
demesh = DeconstructMesh(Mesh=explode)  # -> Vertices, Faces, Colours, Normals
item = ListItem(List=demesh.Vertices, Index=0, Wrap=True)
pdecon = Deconstruct(Point=item)  # -> XComponent, YComponent, ZComponent
bnd = Bounds(Numbers=flatten(pdecon.ZComponent))
remap = RemapNumbers(Value=pdecon.ZComponent, Source=bnd, Target=Domain(0, 1))  # -> Mapped, Clipped
gradient = Gradient(
    LowerLimit=0,
    UpperLimit=1,
    Parameter=remap.Mapped,
    stops=[0: RGB(0, 97, 68), 0.25: RGB(81, 175, 17), 0.5: RGB(159, 198, 146), 0.75: RGB(170, 235, 41), 1: RGB(221, 255, 53)])

dedomain = DeconstructDomain(Domain=debox.X)  # -> Start, End
dedomain_2 = DeconstructDomain(Domain=debox.Y)  # -> Start, expr("-x/2", End)
dedomain_3 = DeconstructDomain(Domain=debox.X)  # -> Start, expr("-x/2", End)
division = Division(A=landscape_size_2, B=dedomain.End)
jagged = SettingsSpeed()
Z = UnitZ(Factor=1)
X = UnitX(Factor=dedomain_3.End)
Y = UnitY(Factor=dedomain_2.End)
move = Move(Geometry=interpolate.Curve, Motion=X)  # -> Geometry, Transform
move_2 = Move(Geometry=move.Geometry, Motion=Y)  # -> Geometry, Transform
scale = Scale(Geometry=move_2.Geometry, Center=Point(0, 0, 0), Factor=division)  # -> Geometry, Transform
loft_2 = Loft(
    Curves=flatten(scale.Geometry),
    Options={Adjust=False, Closed=False, LoftEnds=0, LoftSimp=0, LoftType=0, Rebuild=10, Refit=0.01})
mesh_2 = MeshBrep(Brep=loft_2, Settings=jagged)
bbox_2 = BoundingBox(Content=flatten(scale.Geometry), Plane=PlaneXY(0, 0, 0), UnionBox=True)  # -> Box, Box_2
debrep = DeconstructBrep(Brep=bbox_2.Box)  # -> Faces, Edges, Vertices
item_2 = ListItem(List=debrep.Faces, Index=4, Wrap=True)

# ----
# Select Mesh
mplane = MeshPlane(Boundary=item_2, WidthCount=ysize_2, HeightCount=ysize_2)  # -> Mesh, Area
flip = FlipMatrix(Data=reddata_2)
meshselector = Ladybug_MeshThresholdSelector(inputMesh=mplane.Mesh, analysisResult=flatten(flip), operator=">", levelOfPerform=place_of_interest_threshold_2)  # -> readMe, totalValue, areaMeetsThresh, newColoredMesh, newMeshOutline; plug-in component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
demesh_2 = DeconstructMesh(Mesh=meshselector.newColoredMesh)  # -> Vertices, Faces, Colours, Normals

srf = Surface(meshselector.newMeshOutline)
mesh_3 = Mesh(graft(meshselector.newMeshOutline))
sdivide = DivideSurface(Surface=srf, UCount=number_slider, VCount=number_slider)  # -> Points, Normals, Parameters
pshift = ShiftPaths(Data=sdivide.Points, Offset=-1)
clean = CleanTree(RemoveNulls=True, RemoveInvalid=True, RemoveEmpty=False, Tree=pshift)
meshray = MeshRay(Mesh=mesh_2, Point=clean, Direction=Z)  # -> Point, Hit

topo_fragments_to_color = Geometry(explode)
points_on_topo = Point(meshray.Point)
points_of_interest = Point(demesh_2.Vertices)
areas_of_interest = Curve(meshselector.newMeshOutline)
working_surface = Surface(item_2)
topo_colors = Data(gradient)
toposurface = Surface(loft_2)
nurbs_curves = Curve(scale.Geometry)

topo_colors_2 = ClusterOutput(topo_colors)
toposurface_2 = ClusterOutput(toposurface)
areas_of_interest_2 = ClusterOutput(areas_of_interest)
points_of_interest_2 = ClusterOutput(points_of_interest)
points_on_topo_2 = ClusterOutput(points_on_topo)
nurbs_curves_2 = ClusterOutput(nurbs_curves)
working_surface_2 = ClusterOutput(working_surface)
topo_fragments_to_color_2 = ClusterOutput(topo_fragments_to_color)

# ==== cluster Cluster_2
weatherfileurl = ClusterInput()
enable = ClusterInput()
enable_2 = Boolean(enable)

# ----
# Construct Sky Matrix
epw_stat = Ladybug_OpenEPWAndSTATWeatherFiles(weatherFileURL=weatherfileurl)  # -> epwFile, statFile; plug-in component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
gencumulativeskymtx = Ladybug_GenCumulativeSkyMtx(epwFile=epw_stat.epwFile, skyDensity=0, useOldRes=True, runIt=enable_2)  # -> readMe, cumulativeSkyMtx; plug-in component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
analysisperiod = Ladybug_AnalysisPeriod()  # -> readMe, analysisPeriod; plug-in component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
selectskymtx = Ladybug_selectSkyMtx(
    cumulativeSkyMtx=gencumulativeskymtx.cumulativeSkyMtx,
    analysisPeriod=analysisperiod.analysisPeriod,
    removeDiffuse=False,
    removeDirect=False)  # -> readMe, selectedSkyMtx; plug-in component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
skydome = Ladybug_SkyDome(selectedSkyMtx=selectskymtx.selectedSkyMtx, showTotalOnly=False, bakeIt="2", runIt=Toggle(True))  # -> readMe, skyPatchesMesh, baseCrvs, altitudeCrvs, legend, legendBasePts, skyPatchesCenPts, skyPatchesAreas, skyPatchesAsBrep, values; plug-in component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
flip = FlipMatrix(Data=skydome.values)
flip_2 = FlipMatrix(Data=skydome.skyPatchesCenPts)
item = ListItem(List=flatten(skydome.skyPatchesMesh), Index=0, Wrap=True)
item_2 = ListItem(List=flip, Index=0, Wrap=True)
item_3 = ListItem(List=flip_2, Index=0, Wrap=True)
flip_3 = FlipMatrix(Data=item_3)
flip_4 = FlipMatrix(Data=item_2)
skydome_mesh = Mesh(item)  # disabled
radiation_values = Number(flip_4)
skydome_points = Point(flip_3)

skydome_mesh_2 = ClusterOutput(skydome_mesh)
radiation_values_2 = ClusterOutput(radiation_values)
skydome_points_2 = ClusterOutput(skydome_points)

# ==== cluster Cluster_3
trees_as_crvs = ClusterInput()
trees_as_crvs_2 = Curve(reparameterize(trees_as_crvs))
end = EndPoints(Curve=trees_as_crvs_2)  # -> Start, End
eval = EvaluateCurve(Curve=trees_as_crvs_2, Parameter=0.25)  # -> Point, Tangent, Angle
pipe = Pipe(Curve=trees_as_crvs_2, Radius=Slider(0.25, range=0..1), Caps=0)
ln = Line(StartPoint=end.End, EndPoint=eval.Point)
dist = Distance(PointA=end.End, PointB=eval.Point)
eval_2 = EvaluateCurve(Curve=reparameterize(ln), Parameter=0.5)  # -> Point, Tangent, Angle
pshift = ShiftPaths(Data=pipe, Offset=-1)
Y = UnitY(Factor=1)
X = UnitX(Factor=1)
jagged = SettingsSpeed()
circle = CircleCNR(Center=eval_2.Point, Normal=X, Radius=expr("x/2", dist))
circle_2 = CircleCNR(Center=eval_2.Point, Normal=Y, Radius=expr("x/2", dist))
mesh = MeshBrep(Brep=graft(pshift), Settings=jagged)
mesh_2 = MeshBrep(Brep=graft(circle), Settings=jagged)
mesh_3 = MeshBrep(Brep=graft(circle_2), Settings=jagged)
mesh_4 = Mesh(pshift)
stick = Geometry(pshift)
mjoin = MeshJoin(Meshes=[mesh_3, mesh_2, mesh])
stick_2 = ClusterOutput(stick)
pshift_2 = ShiftPaths(Data=mjoin, Offset=-1)
tree_objects = Geometry(pshift_2)
tree_objects_2 = ClusterOutput(tree_objects)

# ==== cluster Cluster_4
possible_trees_within_reason = ClusterInput()
trees_per_patch = ClusterInput()
tree_height = ClusterInput()
possible_trees_within_reason_2 = Point(possible_trees_within_reason)
trees_per_patch_2 = Number(trees_per_patch)
tree_height_2 = Number(tree_height)
range = Range(Domain=Domain(0, 1), Steps=trees_per_patch_2)
graph = GraphMapper(
    range,
    x0=0,
    x1=1,
    y0=0,
    y1=1,
    container_name="Bezier",
    cpx=[0, 0.7185270786, 0.8584090471, 1],
    cpy=[0, 0.2889970541, 0.4938248396, 1])
lng = ListLength(List=possible_trees_within_reason_2)
Z = UnitZ(Factor=1)
dom = ConstructDomain(DomainStart=0, DomainEnd=lng)
line = LineSDL(Start=possible_trees_within_reason_2, Direction=Z, Length=tree_height_2)  # -> simplify(Line)
remap = RemapNumbers(Value=graph, Source=Domain(0, 1), Target=dom)  # -> Mapped, Clipped
item = ListItem(List=line, Index=remap.Mapped, Wrap=True)
trees_as_crvs = Curve(item)
trees_as_crvs_2 = ClusterOutput(trees_as_crvs)

# ==== cluster Cluster_5
points_of_interest = ClusterInput()
radiation_values = ClusterInput()
working_surface = ClusterInput()
skydome_points = ClusterInput()
enabled = ClusterInput()
tree_height = ClusterInput()

points_of_interest_2 = Point(simplify(points_of_interest))
working_surface_2 = Surface(working_surface)
radiation_values_2 = Number(radiation_values)
skydome_points_2 = Point(skydome_points)
tree_height_2 = Number(tree_height)

enabled_2 = Boolean(enabled)
gate = StreamGate(Stream=points_of_interest_2, Gate=enabled_2)  # -> Target0, Target1
gate_2 = StreamGate(Stream=working_surface_2, Gate=enabled_2)  # -> Target0, Target1
gate_3 = StreamGate(Stream=skydome_points_2, Gate=enabled_2)  # -> Target0, Target1
gate_4 = StreamGate(Stream=radiation_values_2, Gate=enabled_2)  # -> Target0, Target1

points_of_interest_3 = Point(simplify(gate.Target1))
working_surface_3 = Surface(gate_2.Target1)
radiation_values_3 = Number(gate_4.Target1)
skydome_points_3 = Point(gate_3.Target1)
tree_height_3 = Number(tree_height)

jitter = Jitter(List=points_of_interest_3, Jitter=1, Seed=2)  # -> Values, Indices
cull = CullPattern(List=jitter.Values, CullPattern=[True, False, False])
item = ListItem(List=cull, Index=5, Wrap=True)  # -> simplify(graft(Item))
Z = UnitZ(Factor=-1)

# ----
# Solve for Positioning
panel = Panel("0,0,0")
vec2pt = Vector2Pt(PointA=skydome_points_3, PointB=panel, Unitize=False)  # -> unitize(Vector), Length
radiation_values_4 = Number(radiation_values_3)
skydome_vectors = Vector(vec2pt.Vector)
sort = SortList(Keys=radiation_values_4, ValuesA=skydome_vectors)  # -> reverse(Keys), reverse(ValuesA)
Z_2 = UnitZ(Factor=tree_height_3)
skydome_vectors_sorted = Vector(sort.ValuesA)
radiation_values_sorted = Number(sort.Keys)
move = Move(Geometry=working_surface_3, Motion=Z_2)  # -> Geometry, Transform
series = Series(Start=0, Step=1, Count=10)
testpoint = Point(item)
scale = Scale(Geometry=move.Geometry, Center=Point(0, 0, 0), Factor="2.0")  # -> Geometry, Transform
item_2 = ListItem(List=skydome_vectors_sorted, Index=series, Wrap=True)
neg = Negative(Value=item_2)
treeline = Surface(scale.Geometry)
line = LineSDL(Start=testpoint, Direction=neg, Length=50)
group = Group(Objects=cull)
working_surface_4 = Surface(working_surface_3)
Z_3 = UnitZ(Factor=1)

meshray = MeshRay(Mesh=treeline, Point=testpoint, Direction=neg)  # -> Point, Hit

vec2pt_2 = Vector2Pt(PointA=testpoint, PointB=meshray.Point, Unitize=False)  # -> Vector, Length
move_2 = Move(Geometry=group, Motion=vec2pt_2.Vector)  # -> Geometry, Transform
ungroup = Ungroup(Group=move_2.Geometry)
pshift = ShiftPaths(Data=ungroup, Offset=-1)
line_2 = LineSDL(Start=ungroup, Direction=Z_3, Length=1)
lng = ListLength(List=pshift)

pdecon = Deconstruct(Point=ungroup)  # -> XComponent, YComponent, ZComponent
pt = ConstructPoint(XCoordinate=pdecon.XComponent, YCoordinate=pdecon.YComponent, ZCoordinate=100)
meshray_2 = MeshRay(Mesh=working_surface_4, Point=pt, Direction=Z)  # -> Point, Hit

clean = CleanTree(RemoveNulls=True, RemoveInvalid=True, RemoveEmpty=False, Tree=meshray_2.Point)  # -> simplify(Tree)
pshift_2 = ShiftPaths(Data=simplify(clean), Offset=-1)

null = NullItem(Item=pshift_2)  # -> NullFlags, InvalidFlags, Description
filter = StreamFilter(Gate=null.NullFlags, Stream0=pshift_2, Stream1=flatten(clean))

points_within_reason = Data(filter)
height = Data(tree_height_3)

points_within_reason_2 = ClusterOutput(points_within_reason)
height_2 = ClusterOutput(height)

# ==== cluster Cluster_6
radiation_values = ClusterInput()
skydome_points = ClusterInput()
areas_of_interest = ClusterInput()
considered_vectors = ClusterInput()
shade_density = ClusterInput()
toposurface = ClusterInput()
height = ClusterInput()
radiation_values_2 = Number(radiation_values)
skydome_points_2 = Point(skydome_points)
areas_of_interest_2 = Curve(areas_of_interest)
considered_vectors_2 = Number(considered_vectors)
shade_density_2 = Number(shade_density)
toposurface_2 = Surface(toposurface)
height_2 = Number(height)
cp = ControlPoints(Curve=areas_of_interest_2)  # -> Points, Weights, Knots
jagged = SettingsSpeed()
mesh = MeshBrep(Brep=toposurface_2, Settings=jagged)
Z = UnitZ(Factor=1)
vec2pt = Vector2Pt(PointA=skydome_points_2, PointB="0,0,0", Unitize=False)  # -> Vector, Length
bbox = BoundingBox(Content=mesh, Plane=PlaneXY(0, 0, 0))  # -> Box, Box_2
meshray = MeshRay(Mesh=mesh, Point=cp.Points, Direction=Z)  # -> Point, Hit
neg = Negative(Value=vec2pt.Vector)
debrep = DeconstructBrep(Brep=bbox.Box)  # -> Faces, Edges, Vertices
pt = Point(graft(meshray.Point))
sort = SortList(Keys=radiation_values_2, ValuesA=neg)  # -> Keys, reverse(ValuesA)
series = Series(Start=0, Step=1, Count=considered_vectors_2)
Z_2 = UnitZ(Factor=height_2)
item = ListItem(List=debrep.Faces, Index=4, Wrap=True)
item_2 = ListItem(List=sort.ValuesA, Index=series, Wrap=True)
move = Move(Geometry=item, Motion=Z_2)  # -> Geometry, Transform
mesh_2 = Mesh(move.Geometry)
meshray_2 = MeshRay(Mesh=mesh_2, Point=pt, Direction=item_2)  # -> Point, Hit
pshift = ShiftPaths(Data=meshray_2.Point, Offset=-1)
bbox_2 = BoundingBox(Content=pshift, Plane=PlaneXY(0, 0, 0), UnionBox=True)  # -> Box, Box_2
debrep_2 = DeconstructBrep(Brep=bbox_2.Box)  # -> Faces, Edges, Vertices
item_3 = ListItem(List=debrep_2.Faces, Index=4, Wrap=True)
dim = Dimensions(Surface=item_3)  # -> UDimension, VDimension
sdivide = DivideSurface(Surface=item_3, UCount=shade_density_2, VCount=shade_density_2)  # -> Points, Normals, Parameters
division = Division(A=dim.VDimension, B=shade_density_2)
pline = PolyLine(Vertices=sdivide.Points, Closed=False)
Z_3 = UnitZ(Factor=division)
extr = Extrude(Base=pline, Direction=Z_3)
shade_structure = Geometry(extr)
shade_structure_2 = ClusterOutput(shade_structure)

# ==== cluster Cluster_7
radiation_values = ClusterInput()
skydome_points = ClusterInput()
areas_of_interest = ClusterInput()
considered_vectors = ClusterInput()
toposurface = ClusterInput()
height = ClusterInput()
enabled = ClusterInput()
enabled_2 = Boolean(enabled)
radiation_values_2 = Number(radiation_values)
skydome_points_2 = Point(skydome_points)
areas_of_interest_2 = Curve(areas_of_interest)
toposurface_2 = Surface(toposurface)
height_2 = Number(height)
gate = StreamGate(Stream=toposurface_2, Gate=enabled_2)  # -> Target0, Target1
gate_2 = StreamGate(Stream=skydome_points_2, Gate=enabled_2)  # -> Target0, Target1
gate_3 = StreamGate(Stream=areas_of_interest_2, Gate=enabled_2)  # -> Target0, Target1
radiation_values_3 = Number(radiation_values)
skydome_points_3 = Point(gate_2.Target1)
areas_of_interest_3 = Curve(gate_3.Target1)
toposurface_3 = Surface(gate.Target1)
height_3 = Number(height_2)
cp = ControlPoints(Curve=areas_of_interest_3)  # -> Points, Weights, Knots
jagged = SettingsSpeed()
considered_vectors_2 = Number(considered_vectors)
mesh = MeshBrep(Brep=toposurface_3, Settings=jagged)
Z = UnitZ(Factor=1)
vec2pt = Vector2Pt(PointA=skydome_points_3, PointB="0,0,0", Unitize=False)  # -> Vector, Length
bbox = BoundingBox(Content=mesh, Plane=PlaneXY(0, 0, 0))  # -> Box, Box_2
meshray = MeshRay(Mesh=mesh, Point=cp.Points, Direction=Z)  # -> Point, Hit
neg = Negative(Value=vec2pt.Vector)
debrep = DeconstructBrep(Brep=bbox.Box)  # -> Faces, Edges, Vertices
sort = SortList(Keys=radiation_values_3, ValuesA=neg)  # -> Keys, reverse(ValuesA)
series = Series(Start=0, Step=1, Count=considered_vectors_2)
Z_2 = UnitZ(Factor=height_3)
pt = Point(meshray.Point)
item = ListItem(List=debrep.Faces, Index=4, Wrap=True)
item_2 = ListItem(List=sort.ValuesA, Index=series, Wrap=True)  # -> graft(Item)
move = Move(Geometry=item, Motion=Z_2)  # -> Geometry, Transform
mesh_2 = Mesh(move.Geometry)
meshray_2 = MeshRay(Mesh=mesh_2, Point=pt, Direction=item_2)  # -> Point, Hit
pshift = ShiftPaths(Data=meshray_2.Point, Offset=-1)
pline = PolyLine(Vertices=meshray_2.Point, Closed=True)
bbox_2 = BoundingBox(Content=flatten(pline), Plane=PlaneXY(0, 0, 0), UnionBox=True)  # -> Box, Box_2
area = Area(Geometry=bbox_2.Box)  # -> Area, Centroid
xy = XYPlane(Origin=area.Centroid)
project = Project(Geometry=pline, Plane=xy)  # -> Geometry, Transform
number_slider = Slider(10, range=3..10)
runion = RegionUnion(Curves=flatten(project.Geometry))
srf = Surface(runion)
dim = Dimensions(Surface=srf)  # -> UDimension, VDimension
division = Division(A=dim.VDimension, B=number_slider)
division_2 = Division(A=dim.UDimension, B=number_slider)
Z_3 = UnitZ(Factor=-1)
sdivide = DivideSurface(Surface=srf, UCount=division_2, VCount=division)  # -> Points, Normals, Parameters
meshray_3 = MeshRay(Mesh=mesh, Point=sdivide.Points, Direction=Z_3)  # -> Point, Hit
ln = Line(StartPoint=sdivide.Points, EndPoint=meshray_3.Point)
pipe = Pipe(Curve=ln, Radius=0.4, Caps=0)
jagged_2 = SettingsSpeed()
mesh_3 = MeshBrep(Brep=pipe, Settings=jagged_2)
shade_structure_s = Geometry(mesh_3)
shade_structure_s_2 = ClusterOutput(shade_structure_s)
jagged_3 = SettingsSpeed()
mesh_4 = MeshBrep(Brep=srf, Settings=jagged_3)
shade_structure = Geometry(mesh_4)
shade_structure_2 = ClusterOutput(shade_structure)

# ==== cluster Cluster_8
enabled = ClusterInput()
considered_vectors = ClusterInput()
radiation_values = ClusterInput()
areas_of_interest = ClusterInput()
skydome_points = ClusterInput()
toposurface = ClusterInput()
height = ClusterInput()
considered_vectors_2 = Number(considered_vectors)
radiation_values_2 = Number(radiation_values)
areas_of_interest_2 = Curve(areas_of_interest)
skydome_points_2 = Point(skydome_points)
toposurface_2 = Surface(toposurface)
enabled_2 = Boolean(enabled)
height_2 = Number(height)
gate = StreamGate(Stream=considered_vectors_2, Gate=enabled_2)  # -> Target0, Target1
gate_2 = StreamGate(Stream=areas_of_interest_2, Gate=enabled_2)  # -> Target0, Target1
gate_3 = StreamGate(Stream=toposurface_2, Gate=enabled_2)  # -> Target0, Target1
considered_vectors_3 = Number(gate.Target1)
radiation_values_3 = Number(radiation_values)
areas_of_interest_3 = Curve(gate_2.Target1)
skydome_points_3 = Point(skydome_points)
toposurface_3 = Surface(gate_3.Target1)
height_3 = Number(height)
cp = ControlPoints(Curve=areas_of_interest_3)  # -> Points, Weights, Knots
jagged = SettingsSpeed()
mesh = MeshBrep(Brep=toposurface_3, Settings=jagged)
Z = UnitZ(Factor=1)
vec2pt = Vector2Pt(PointA=skydome_points_3, PointB="0,0,0", Unitize=False)  # -> Vector, Length
bbox = BoundingBox(Content=mesh, Plane=PlaneXY(0, 0, 0))  # -> Box, Box_2
meshray = MeshRay(Mesh=mesh, Point=cp.Points, Direction=Z)  # -> Point, Hit
neg = Negative(Value=vec2pt.Vector)
debrep = DeconstructBrep(Brep=bbox.Box)  # -> Faces, Edges, Vertices
sort = SortList(Keys=radiation_values_3, ValuesA=neg)  # -> Keys, reverse(ValuesA)
series = Series(Start=0, Step=1, Count=considered_vectors_3)
Z_2 = UnitZ(Factor=height_3)
pt = Point(meshray.Point)
item = ListItem(List=debrep.Faces, Index=4, Wrap=True)
item_2 = ListItem(List=sort.ValuesA, Index=series, Wrap=True)  # -> graft(Item)
move = Move(Geometry=item, Motion=Z_2)  # -> Geometry, Transform
number_slider = Slider(5, range=3..5)
mesh_2 = Mesh(move.Geometry)
meshray_2 = MeshRay(Mesh=mesh_2, Point=pt, Direction=item_2)  # -> Point, Hit
pshift = ShiftPaths(Data=meshray_2.Point, Offset=-1)
squads = SkewedQuads(Surface=item, UDivisions=number_slider, VDivisions=number_slider, TParameter=0)  # -> FullPanels, EdgePanels
pline = PolyLine(Vertices=meshray_2.Point, Closed=True)
bbox_2 = BoundingBox(Content=flatten(pline), Plane=PlaneXY(0, 0, 0), UnionBox=True)  # -> Box, Box_2
bbox_3 = BoundingBox(Content=flatten(pline), Plane=PlaneXY(0, 0, 0), UnionBox=True)  # -> Box, Box_2
area = Area(Geometry=bbox_3.Box)  # -> Area, Centroid
srf = Surface(squads.FullPanels)
pt_2 = Point(Point(0.5, 0.5, 0))
xy = XYPlane(Origin=area.Centroid)
project = Project(Geometry=pline, Plane=xy)  # -> Geometry, Transform
evalsrf = EvaluateSurface(Surface=reparameterize(srf), Point=pt_2)  # -> Point, Normal, Frame
debrep_2 = DeconstructBrep(Brep=srf)  # -> Faces, Edges, Vertices
runion = RegionUnion(Curves=flatten(project.Geometry))
pt_3 = Point(flatten(cp.Points))
Z_3 = UnitZ(Factor=-100)
extr = Extrude(Base=runion, Direction=Z_3)
dist = Distance(PointA=graft(evalsrf.Point), PointB=simplify(flatten(pt_3)))
cap = CapHoles(Brep=extr)
jagged_2 = SettingsSpeed()
sort_2 = SortList(Keys=dist)  # -> Keys, ValuesA
dist_threshold = ClusterInput()
mesh_3 = MeshBrep(Brep=cap, Settings=jagged_2)
item_3 = ListItem(List=sort_2.Keys, Index=0, Wrap=True)
dist_threshold_2 = Number(dist_threshold)
pshift_2 = ShiftPaths(Data=item_3, Offset=-1)
smaller = SmallerThan(FirstNumber=pshift_2, SecondNumber=dist_threshold_2)  # -> SmallerThan, OrEqualTo
cull = CullPattern(List=evalsrf.Point, CullPattern=invert(smaller.SmallerThan))
cull_2 = CullPattern(List=srf, CullPattern=invert(smaller.SmallerThan))
cull_3 = CullPattern(List=pshift_2, CullPattern=invert(smaller.SmallerThan))
min_height = ClusterInput()
max_height = ClusterInput()
minc = MeshInclusion(Mesh=mesh_3, Point=cull, Strict=False)
min_height_2 = Number(min_height)
max_height_2 = Number(max_height)
cull_4 = CullPattern(List=cull_2, CullPattern=invert(minc))
cull_5 = CullPattern(List=cull_3, CullPattern=invert(minc))
dom = ConstructDomain(DomainStart=min_height_2, DomainEnd=max_height_2)
bnd = Bounds(Numbers=cull_5)
remap = RemapNumbers(Value=cull_5, Source=bnd, Target=dom)  # -> Mapped, Clipped
Z_4 = UnitZ(Factor=remap.Mapped)
remap_2 = RemapNumbers(Value=cull_5, Source=bnd, Target=Domain(0, 1))  # -> Mapped, Clipped
extr_2 = Extrude(Base=cull_4, Direction=Z_4)
gradient = Gradient(LowerLimit=0, UpperLimit=1, Parameter=remap_2.Mapped, stops=[0: RGB(255, 255, 255), 1: RGB(122, 122, 122)])
massings = Geometry(extr_2)
massings_2 = ClusterOutput(massings)
col = Colour(gradient)
col_2 = ClusterOutput(col)
