# Grasshopper definition Tree_Placement_+UI.gh (Grasshopper 0.9.76)

# ----
# Import EPW
panel = Panel("https://www.energyplus.net/weather-download/north_and_central_america_wmo_region_4/USA/NY/USA_NY_New.York-J.F.Kennedy.Intl.AP.744860_TMY3/all")

# ----
# Construct Sky Matrix
cluster = Cluster(weatherfileurl=panel, enable=Toggle(False))  # -> skydome_mesh_2, skydome_points_2, radiation_values_2

radiation_values = Number(cluster.radiation_values_2)
skydome_points = Point(cluster.skydome_points_2)
skydome_mesh = Mesh(cluster.skydome_mesh_2)  # disabled
radiation_values_2 = Number([7.17, 7.2, 7.33, 7.58, 8.06, 10.04, 14.77, 14.63, 15.81, 17.21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])
skydome_points_2 = Point([Point(0, 495.4531246, 51.97717016), Point(103.0104967, 484.6262866, 51.97717017), Point(201.5189421, 452.6189525, 51.97717104), Point(291.2200421, 400.8299978, 51.97716862), Point(368.193427, 331.5228504, 51.97717082), Point(429.0749937, 247.7265633, 51.97717062)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])
mesh = Mesh(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)

# ----
# Input from Image
working_region = Curve(<curve referenced from the Rhino model>)
regions_to_shade = Curve([<curve referenced from the Rhino model> x2])

# ----
# Visualize Vectors
radiation_values_3 = Number(radiation_values_2)
skydome_points_3 = Point(skydome_points_2)
vec2pt = Vector2Pt(PointA=skydome_points_3, PointB="0,0,0", Unitize=False)  # -> unitize(Vector), Length
bnd = Bounds(Numbers=radiation_values_3)
multiplication = Multiplication(A=vec2pt.Vector, B=radiation_values_3)
vdisex = VectorDisplayEx(Point=skydome_points_3, Vector=multiplication, Colour=ColourSwatch(SwatchColor=RGBA(219, 219, 219, 105)), Width=2)

preview = CustomPreview(Geometry=working_region, Shader=ColourSwatch(SwatchColor=RGB(207, 207, 207)))

# ----
# Solve for Positioning
cluster_2 = Cluster_4(
    tree_height=Slider(13, range=1..20),
    sample_size=Slider(4, range=4..10),
    working_surface=working_region,
    regions_to_shade=regions_to_shade,
    skydome_points=skydome_points_2,
    radiation_values=radiation_values_2)  # -> tree_height_4, possible_trees_within_reason_2

# ----
# Visualize Vectors
number_slider = Slider(11, range=0..20)
cluster_3 = Cluster_3(
    tree_height=cluster_2.tree_height_4,
    possible_trees_within_reason=cluster_2.possible_trees_within_reason_2,
    trees_per_patch=number_slider)

# ----
# Generate Rep
cluster_4 = Cluster_2(trees_as_crvs=cluster_3)

# ----
# Visualize By Efficiency
tree_objects = Geometry(cluster_4)
lng = ListLength(List=tree_objects)
range = Range(Domain=Domain(0, 1), Steps=expr("x-1", lng))
gradient = Gradient(
    LowerLimit=0,
    UpperLimit=1,
    Parameter=range,
    stops=[0: RGB(234, 38, 0), 0.25: RGB(234, 126, 0), 0.5: RGB(254, 244, 84), 0.75: RGB(173, 203, 249), 1: RGB(75, 107, 169)])
preview_2 = CustomPreview(Geometry=tree_objects, Shader=gradient)

# ==== cluster Cluster
weatherfileurl = ClusterInput()
enable = ClusterInput()
enable_2 = Boolean(enable)

# ----
# Construct Sky Matrix
epw_stat = Ladybug_OpenEPWAndSTATWeatherFiles(weatherFileURL=weatherfileurl)  # -> epwFile, statFile; plug-in component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
gencumulativeskymtx = Ladybug_GenCumulativeSkyMtx(epwFile=epw_stat.epwFile, skyDensity=0, useOldRes=True, runIt=enable_2)  # -> readMe, cumulativeSkyMtx; plug-in component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
analysisperiod = Ladybug_AnalysisPeriod()  # -> readMe, analysisPeriod; plug-in component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
selectskymtx = Ladybug_selectSkyMtx(
    cumulativeSkyMtx=gencumulativeskymtx.cumulativeSkyMtx,
    analysisPeriod=analysisperiod.analysisPeriod,
    removeDiffuse=False,
    removeDirect=False)  # -> readMe, selectedSkyMtx; plug-in component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
skydome = Ladybug_SkyDome(selectedSkyMtx=selectskymtx.selectedSkyMtx, showTotalOnly=False, bakeIt="2", runIt=Toggle(True))  # -> readMe, skyPatchesMesh, baseCrvs, altitudeCrvs, legend, legendBasePts, skyPatchesCenPts, skyPatchesAreas, skyPatchesAsBrep, values; plug-in component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
flip = FlipMatrix(Data=skydome.values)
flip_2 = FlipMatrix(Data=skydome.skyPatchesCenPts)
item = ListItem(List=flatten(skydome.skyPatchesMesh), Index=0, Wrap=True)
item_2 = ListItem(List=flip, Index=0, Wrap=True)
item_3 = ListItem(List=flip_2, Index=0, Wrap=True)
flip_3 = FlipMatrix(Data=item_3)
flip_4 = FlipMatrix(Data=item_2)
skydome_mesh = Mesh(item)  # disabled
radiation_values = Number(flip_4)
skydome_points = Point(flip_3)

skydome_points_2 = ClusterOutput(skydome_points)
radiation_values_2 = ClusterOutput(radiation_values)
skydome_mesh_2 = ClusterOutput(skydome_mesh)

# ==== cluster Cluster_2
trees_as_crvs = ClusterInput()
trees_as_crvs_2 = Curve(trees_as_crvs)
pipe = Pipe(Curve=trees_as_crvs_2, Radius=Slider(0.25, range=0..1), Caps=0)
pshift = ShiftPaths(Data=pipe, Offset=-1)
tree_objects = Geometry(pshift)
tree_objects_2 = ClusterOutput(tree_objects)

# ==== cluster Cluster_3
tree_height = ClusterInput()
possible_trees_within_reason = ClusterInput()
trees_per_patch = ClusterInput()
possible_trees_within_reason_2 = Point(possible_trees_within_reason)
trees_per_patch_2 = Number(trees_per_patch)
tree_height_2 = Number(tree_height)
pshift = ShiftPaths(Data=possible_trees_within_reason_2, Offset=-1)
range = Range(Domain=Domain(0, 1), Steps=trees_per_patch_2)
graph = GraphMapper(
    range,
    x0=0,
    x1=1,
    y0=0,
    y1=1,
    container_name="Bezier",
    cpx=[0, 0.7185270786, 0.8584090471, 1],
    cpy=[0, 0.2889970541, 0.4938248396, 1])
lng = ListLength(List=pshift)
Z = UnitZ(Factor=1)
dom = ConstructDomain(DomainStart=0, DomainEnd=lng)
line = LineSDL(Start=possible_trees_within_reason_2, Direction=Z, Length=tree_height_2)  # -> simplify(Line)
remap = RemapNumbers(Value=graph, Source=Domain(0, 1), Target=dom)  # -> Mapped, Clipped
pshift_2 = ShiftPaths(Data=line, Offset=-1)
item = ListItem(List=pshift_2, Index=remap.Mapped, Wrap=True)
trees_as_crvs = Curve(item)
trees_as_crvs_2 = ClusterOutput(trees_as_crvs)

# ==== cluster Cluster_4
working_surface = ClusterInput()
regions_to_shade = ClusterInput()
tree_height = ClusterInput()
skydome_points = ClusterInput()
radiation_values = ClusterInput()
sample_size = ClusterInput()

tree_height_2 = Number(tree_height)
sample_size_2 = Number(sample_size)
working_surface_2 = Surface(working_surface)
regions_to_shade_2 = Curve(regions_to_shade)
skydome_points_2 = Point(skydome_points)
radiation_values_2 = Number(radiation_values)

# ----
# Solve for Positioning
panel = Panel("0,0,0")
vec2pt = Vector2Pt(PointA=skydome_points_2, PointB=panel, Unitize=False)  # -> unitize(Vector), Length
radiation_values_3 = Number(radiation_values_2)
skydome_vectors = Vector(vec2pt.Vector)
srf = Surface(regions_to_shade_2)
sort = SortList(Keys=radiation_values_3, ValuesA=skydome_vectors)  # -> reverse(Keys), reverse(ValuesA)
area = Area(Geometry=regions_to_shade_2)  # -> Area, graft(Centroid)
Z = UnitZ(Factor=tree_height_2)
sdivide = DivideSurface(Surface=srf, UCount=sample_size_2, VCount=sample_size_2)  # -> Points, Normals, Parameters
skydome_vectors_sorted = Vector(sort.ValuesA)
radiation_values_sorted = Number(sort.Keys)
move = Move(Geometry=working_surface_2, Motion=Z)  # -> Geometry, Transform
series = Series(Start=0, Step=1, Count=10)
clean = CleanTree(RemoveNulls=True, RemoveInvalid=True, RemoveEmpty=False, Tree=sdivide.Points)
testpoint = Point(area.Centroid)
pshift = ShiftPaths(Data=clean, Offset=-1)
scale = Scale(Geometry=move.Geometry, Center=Point(0, 0, 0), Factor="2.0")  # -> Geometry, Transform
item = ListItem(List=skydome_vectors_sorted, Index=series, Wrap=True)
neg = Negative(Value=item)
treeline = Surface(scale.Geometry)
line = LineSDL(Start=testpoint, Direction=neg, Length=1)
group = Group(Objects=pshift)
slx = SurfaceLine(Surface=treeline, Line=line, LimitToFirst=False)  # -> Curves, Points, UVPoints, Normal
working_surface_3 = Surface(working_surface_2)
pshift_2 = ShiftPaths(Data=slx.Points, Offset=-1)
vec2pt_2 = Vector2Pt(PointA=testpoint, PointB=pshift_2, Unitize=False)  # -> Vector, Length
move_2 = Move(Geometry=group, Motion=vec2pt_2.Vector)  # -> Geometry, Transform
ungroup = Ungroup(Group=move_2.Geometry)
Z_2 = UnitZ(Factor=1)
pshift_3 = ShiftPaths(Data=ungroup, Offset=-1)
line_2 = LineSDL(Start=ungroup, Direction=Z_2, Length=1)
lng = ListLength(List=pshift_3)
slx_2 = SurfaceLine(Surface=working_surface_3, Line=line_2, LimitToFirst=False)  # -> Curves, Points, UVPoints, Normal
pshift_4 = ShiftPaths(Data=simplify(slx_2.Points), Offset=-1)

possible_trees_within_reason = Data(pshift_4)
tree_height_3 = Data(tree_height_2)

tree_height_4 = ClusterOutput(tree_height_3)
possible_trees_within_reason_2 = ClusterOutput(possible_trees_within_reason)
