# Grasshopper definition LANDSAT_Thermal_Image_Importer.gh (Grasshopper 0.9.76)
# plug-ins: Python Interpreter

# ----
# Center the Image on the EPW latitude / longitude
san_francisco_epw = Panel("https://www.energyplus.net/weather-download/north_and_central_america_wmo_region_4/USA/CA/USA_CA_San.Francisco.Intl.AP.724940_TMY3/all")
epw_stat = Ladybug_OpenEPWAndSTATWeatherFiles(weatherFileURL=san_francisco_epw)  # -> epwFile, statFile; plug-in component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
importlocation = Ladybug_ImportLocation(epwFile=epw_stat.epwFile)  # -> location; plug-in component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
explodelocation = Ladybug_DecomposeLocation(location=importlocation)  # -> locationName, latitude, longitude, timeZone, elevation; plug-in component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

ladybug = Ladybug_Ladybug()  # -> Vviiiiiiiiiizzz; plug-in component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
dragonfly = Dragonfly_Dragonfly()  # -> Vviiiiiiiiiizzz; plug-in component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

# ----
# Customize with LegendPar
panel = Panel("20")
legendpar = Ladybug_LegendParameters(lowBound=panel, highBound="40", numSegments="11", legendScale="0.75", decimalPlaces="0")  # -> legendPar; plug-in component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

panel_2 = Panel("D:\users\sgaray\Documents\GitHub\SolarSculptor\resources\testImage\GradientImg.png")
# Set to LANDSAT Filepath
file_path_to_the_landsat_directory = Panel("C:\Users\mackey\Desktop\DF\TestLANDSAT\SanFran_June_2011")
python_script = PythonScript(imagePath=panel_2, run=Toggle(True), step=Slider(100, range=0..100))  # -> out, redData, greenData, blueData, alphaData, xSize, ySize; inputs run: Boolean, step: Int32
# ---------- python_script: Python ----------
import os
from System import Object
import Grasshopper.Kernel as gh
from Grasshopper import DataTree
from Grasshopper.Kernel.Data import GH_Path
from System.Drawing import Image

redDataTree = DataTree[Object]()
greenDataTree = DataTree[Object]()
blueDataTree = DataTree[Object]()
alphaDataTree = DataTree[Object]()
redData = []
greenData = []
blueData =[]
alphaData=[]

if run:
    img = Image.FromFile(imagePath)
    for indexY, y in enumerate(range(0, img.Height,step)):

        yPath = GH_Path(indexY)
        for indexX, x in enumerate(range(0,img.Width, step)):
            colorData = img.GetPixel(x, y)
            redDataTree.Add(colorData.R/255, yPath)
            greenDataTree.Add(colorData.G/255, yPath)
            blueDataTree.Add(colorData.B/255, yPath)
            alphaDataTree.Add(colorData.A/255, yPath)

redData, greenData, blueData, alphaData = [redDataTree, greenDataTree, blueDataTree, alphaDataTree]
xSize = indexX; ySize = indexY
# ---------- end python_script ----------
square = Square(Plane=PlaneXY(0, 0, 0), Size=1, ExtentX=python_script.xSize, ExtentY=python_script.ySize)  # -> Cells, Points
deconstruct = Deconstruct(Point=square.Points)  # -> simplify(XComponent), simplify(YComponent), ZComponent
# Import Image
toggle = BooleanToggle(False)
km_width_length = Panel("40")
pixels_to_skip = Panel("4")
multiplication = Multiplication(A=python_script.redData, B=Slider(1, range=1..50))
construct_point = ConstructPoint(XCoordinate=deconstruct.XComponent, YCoordinate=deconstruct.YComponent, ZCoordinate=multiplication)
panel_3 = Panel(python_script.alphaData)
panel_4 = Panel(python_script.redData)

importlandsatimg = Dragonfly_ImportLANDSATImage(
    landsatImgFolder=file_path_to_the_landsat_directory,
    latitude=explodelocation.latitude,
    longitude=explodelocation.longitude,
    imageWidth=km_width_length,
    imageHeight=km_width_length,
    sampleSize=pixels_to_skip,
    legendPar=legendpar,
    runIt=toggle)  # -> readMe, values, geoTiffPts, ptColors, port, legend, legendBasePt, title, titleBasePt; plug-in component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
preview = CustomPreview(Geometry=importlandsatimg.geoTiffPts, Shader=importlandsatimg.ptColors)
geo = Geometry(importlandsatimg.legend)

interpolate = Interpolate(Vertices=construct_point, Degree=3, Periodic=False, KnotStyle=1)  # -> Curve, Length, Domain
loft = Loft(
    Curves=flatten(interpolate.Curve),
    Options={Adjust=False, Closed=False, LoftEnds=0, LoftSimp=0, LoftType=0, Rebuild=10, Refit=0.01})
panel_5 = Panel(python_script.greenData)
panel_6 = Panel(python_script.blueData)
